# Grasshopper definition V1.gh (Grasshopper 1.0.5)

pt = Point(Point(2919.914683, 1973.444328, -6.5))
pt_2 = Point(Point(3263.578487, -42.87340651, -6.5))
num = Number(Slider(150.5, range=0..1000))
ln = Line(StartPoint=pt, EndPoint=pt_2)
Z = UnitZ(Factor=num)
number_slider = Slider(17, range=0..100)
extr = Extrude(Base=ln, Direction=Z)
divide = DivideDomain²(Domain=extr, UCount=Slider(3, range=0..10), VCount=number_slider)
subsrf = Isotrim(Surface=extr, Domain=divide)
partition = PartitionList(List=subsrf, Size=number_slider)
flip = FlipMatrix(Data=partition)
item = ListItem(List=flip, Index=0, Wrap=True)  # -> Item, flatten(Item1)
data = Data(item.Item1)
dispatch = Dispatch(List=data, DispatchPattern=[True, False])  # -> ListA, ListB
data_2 = Data(data)
area = Area(Geometry=data_2)  # -> Area, Centroid
srf_cp = SurfaceClosestPoint(Point=area.Centroid, Surface=item.Item1)  # -> Point, UVPoint, Distance

# ---- group: RH_IN:Height
num_2 = Number(Slider(0.8, range=0.5..0.9))

# ---- group: RH_IN:Width
num_3 = Number(Slider(0.8, range=0.3..0.8))

# ----
evalsrf = EvaluateSurface(Surface=item.Item1, Point=srf_cp.UVPoint)  # -> Point, Normal, UDirection, VDirection, Frame
scale_nu = ScaleNU(Geometry=data_2, Plane=evalsrf.Frame, ScaleX=num_2, ScaleY=num_3, ScaleZ=1)  # -> Geometry, Transform
debrep = DeconstructBrep(Brep=scale_nu.Geometry)  # -> Faces, Edges, Vertices
item_2 = ListItem(List=evalsrf.Frame, Index=0, Wrap=True)
deplane = DeconstructPlane(Plane=item_2)  # -> Origin, XAxis, YAxis, ZAxis
multiplication = Multiplication(A=deplane.ZAxis, B=Slider(12, range=0..100))
number_slider_2 = Slider(3, range=0..10)

# ---- group: RH_IN:Depth
int = Integer(Slider(31, range=0..100))

# ----
evalsrf_2 = EvaluateSurface(Surface=reparameterize(extr), Point="0.5,0.5")  # -> Point, Normal, UDirection, VDirection, Frame
move = Move(Geometry=debrep.Edges, Motion=multiplication)  # -> Geometry, Transform
amp = Amplitude(Vector=evalsrf_2.Normal, Amplitude=int)
item_3 = ListItem(List=move.Geometry, Index=0, Wrap=True)  # -> Item, Item1, Item2
extr_2 = Extrude(Base=item_3.Item, Direction=amp)
evalsrf_3 = EvaluateSurface(Surface=reparameterize(extr_2), Point="0.5,0.5")  # -> Point, Normal, UDirection, VDirection, Frame
extr_3 = Extrude(Base=item_3.Item2, Direction=amp)
amp_2 = Amplitude(Vector=evalsrf_3.Normal, Amplitude=number_slider_2)
panel = Panel("0.5,0.5")
extr_4 = Extrude(Base=extr_2, Direction=amp_2)
evalsrf_4 = EvaluateSurface(Surface=reparameterize(extr_3), Point="0.5,0.5")  # -> Point, Normal, UDirection, VDirection, Frame
pt_3 = ConstructPoint(XCoordinate=0, YCoordinate=0, ZCoordinate=0)
amp_3 = Amplitude(Vector=evalsrf_4.Normal, Amplitude=number_slider_2)
scale = Scale(Geometry=extr_4, Center=pt_3, Factor="0.0254")  # -> Geometry, Transform

# ---- group: RH_OUT:Shader2
mesh = Mesh(scale.Geometry)

# ----
extr_5 = Extrude(Base=extr_3, Direction=amp_3)
pt_4 = ConstructPoint(XCoordinate=0, YCoordinate=0, ZCoordinate=0)
scale_2 = Scale(Geometry=extr_5, Center=pt_4, Factor="0.0254")  # -> Geometry, Transform

# ---- group: RH_OUT:Shader3
mesh_2 = Mesh(scale_2.Geometry)
