# Grasshopper definition Window1.gh (Grasshopper 1.0.5)

pt = Point(Point(2919.914683, 1973.444328, -6.5))
pt_2 = Point(Point(3263.578487, -42.87340651, -6.5))
num = Number(Slider(150.5, range=0..1000))
ln = Line(StartPoint=pt, EndPoint=pt_2)
Z = UnitZ(Factor=num)
number_slider = Slider(17, range=0..100)
extr = Extrude(Base=ln, Direction=Z)
divide = DivideDomain²(Domain=extr, UCount=Slider(3, range=0..10), VCount=number_slider)
subsrf = Isotrim(Surface=extr, Domain=divide)
partition = PartitionList(List=subsrf, Size=number_slider)
flip = FlipMatrix(Data=partition)
item = ListItem(List=flip, Index=0, Wrap=True)  # -> Item, flatten(Item1)
data = Data(item.Item1)
dispatch = Dispatch(List=data, DispatchPattern=[True, False])  # -> ListA, ListB
data_2 = Data(data)
area = Area(Geometry=data_2)  # -> Area, Centroid
srf_cp = SurfaceClosestPoint(Point=area.Centroid, Surface=item.Item1)  # -> Point, UVPoint, Distance

# ---- group: RH_IN:Height
num_2 = Number(Slider(0.8, range=0.5..0.9))

# ---- group: RH_IN:Width
num_3 = Number(Slider(0.7, range=0.3..0.8))

# ----
evalsrf = EvaluateSurface(Surface=item.Item1, Point=srf_cp.UVPoint)  # -> Point, Normal, UDirection, VDirection, Frame
scale_nu = ScaleNU(Geometry=data_2, Plane=evalsrf.Frame, ScaleX=num_2, ScaleY=num_3, ScaleZ=1)  # -> Geometry, Transform
division = Division(A=num, B=Slider(3, range=0..10))
Z_2 = UnitZ(Factor=division)
multiplication = Multiplication(A=division, B="2")
extr_2 = Extrude(Base=ln, Direction=Z_2)
move = Move(Geometry=extr_2, Motion=Z_2)  # -> Geometry, Transform
Z_3 = UnitZ(Factor=multiplication)
debrep = DeconstructBrep(Brep=scale_nu.Geometry)  # -> Faces, Edges, Vertices
debrep_2 = DeconstructBrep(Brep=move.Geometry)  # -> Faces, Edges, Vertices
move_2 = Move(Geometry=extr_2, Motion=Z_3)  # -> Geometry, Transform
join = JoinCurves(Curves=debrep.Edges, Preserve=False)  # -> flatten(Curves)
join_2 = JoinCurves(Curves=debrep_2.Edges, Preserve=False)  # -> flatten(Curves)
join_3 = JoinCurves(Curves=[join_2, join], Preserve=False)
item_2 = ListItem(List=evalsrf.Frame, Index=0, Wrap=True)
deplane = DeconstructPlane(Plane=item_2)  # -> Origin, XAxis, YAxis, ZAxis
boundary = BoundarySurfaces(Edges=join_3)
multiplication_2 = Multiplication(A=deplane.ZAxis, B=Slider(2, range=0..10))
extr_3 = Extrude(Base=scale_nu.Geometry, Direction=multiplication_2)
smesh = SimpleMesh(Brep=extr_3)
evalsrf_2 = EvaluateSurface(Surface=reparameterize(debrep.Faces), Point="0.5,0.5")  # -> Point, Normal, UDirection, VDirection, Frame
amp = Amplitude(Vector=evalsrf_2.Normal, Amplitude=Slider(5, range=0..10))
pt_3 = ConstructPoint(XCoordinate=0, YCoordinate=0, ZCoordinate=0)
move_3 = Move(Geometry=smesh, Motion=amp)  # -> Geometry, Transform
scale = Scale(Geometry=move_3.Geometry, Center=pt_3, Factor="0.0254")  # -> Geometry, Transform

# ---- group: RH_OUT:Glass
mesh = Mesh(scale.Geometry)
