# Grasshopper definition hack14.gh (Grasshopper 1.0.5)

pt = Point(Point(2919.914683, 1973.444328, -6.5))
pt_2 = Point(Point(3263.578487, -42.87340651, -6.5))
num = Number(Slider(150.5, range=0..1000))
ln = Line(StartPoint=pt, EndPoint=pt_2)
Z = UnitZ(Factor=num)
number_slider = Slider(17, range=0..100)
extr = Extrude(Base=ln, Direction=Z)
divide = DivideDomain²(Domain=extr, UCount=Slider(3, range=0..10), VCount=number_slider)
subsrf = Isotrim(Surface=extr, Domain=divide)
partition = PartitionList(List=subsrf, Size=number_slider)
flip = FlipMatrix(Data=partition)
item = ListItem(List=flip, Index=0, Wrap=True)  # -> Item, flatten(Item1)
data = Data(item.Item1)
dispatch = Dispatch(List=data, DispatchPattern=[True, False])  # -> ListA, ListB
data_2 = Data(data)
area = Area(Geometry=data_2)  # -> Area, Centroid
srf_cp = SurfaceClosestPoint(Point=area.Centroid, Surface=item.Item1)  # -> Point, UVPoint, Distance

# ---- group: RH_IN:Height
num_2 = Number(Slider(0.8, range=0.5..0.9))

# ---- group: RH_IN:Width
num_3 = Number(Slider(0.8, range=0.3..0.8))

# ----
evalsrf = EvaluateSurface(Surface=item.Item1, Point=srf_cp.UVPoint)  # -> Point, Normal, UDirection, VDirection, Frame
scale_nu = ScaleNU(Geometry=data_2, Plane=evalsrf.Frame, ScaleX=num_2, ScaleY=num_3, ScaleZ=1)  # -> Geometry, Transform
division = Division(A=num, B=Slider(3, range=0..10))
Z_2 = UnitZ(Factor=division)
multiplication = Multiplication(A=division, B="2")
extr_2 = Extrude(Base=ln, Direction=Z_2)
move = Move(Geometry=extr_2, Motion=Z_2)  # -> Geometry, Transform
Z_3 = UnitZ(Factor=multiplication)
debrep = DeconstructBrep(Brep=scale_nu.Geometry)  # -> Faces, Edges, Vertices
debrep_2 = DeconstructBrep(Brep=move.Geometry)  # -> Faces, Edges, Vertices
move_2 = Move(Geometry=extr_2, Motion=Z_3)  # -> Geometry, Transform
join = JoinCurves(Curves=debrep.Edges, Preserve=False)  # -> flatten(Curves)
join_2 = JoinCurves(Curves=debrep_2.Edges, Preserve=False)  # -> flatten(Curves)
X = UnitX(Factor="12")
join_3 = JoinCurves(Curves=[join_2, join], Preserve=False)
item_2 = ListItem(List=evalsrf.Frame, Index=0, Wrap=True)

# ---- group: RH_IN:mVert
int = Integer(Slider(10, range=0..10))

# ----
move_3 = Move(Geometry=debrep.Edges, Motion=X)  # -> Geometry, Transform
item_3 = ListItem(List=move_3.Geometry, Index=0, Wrap=True)  # -> Item, Item1, Item2, Item3
deplane = DeconstructPlane(Plane=item_2)  # -> Origin, XAxis, YAxis, ZAxis
boundary = BoundarySurfaces(Edges=join_3)
X_2 = UnitX(Factor=int)
multiplication_2 = Multiplication(A=deplane.ZAxis, B=Slider(12, range=0..100))
extr_3 = Extrude(Base=item_3.Item, Direction=X_2)
extr_4 = Extrude(Base=item_3.Item2, Direction=X_2)
multiplication_3 = Multiplication(A=deplane.ZAxis, B=Slider(2, range=0..10))
Y = UnitY(Factor=1)
neg = Negative(Value=Y)
extr_5 = Extrude(Base=boundary, Direction=multiplication_2)
extr_6 = Extrude(Base=extr_2, Direction=multiplication_2)
extr_7 = Extrude(Base=move_2.Geometry, Direction=multiplication_2)
extr_8 = Extrude(Base=scale_nu.Geometry, Direction=multiplication_3)
extr_9 = Extrude(Base=extr_3, Direction=Y)
extr_10 = Extrude(Base=extr_4, Direction=neg)
smesh = SimpleMesh(Brep=extr_6)
smesh_2 = SimpleMesh(Brep=extr_7)
mesh = Mesh(extr_5)
mjoin = MeshJoin(Meshes=flatten([mesh, smesh_2, smesh]))

# ---- group: RH_IN:mHoriz
int_2 = Integer(Slider(10, range=0..10))

# ----
X_3 = UnitX(Factor=int_2)
extr_11 = Extrude(Base=item_3.Item1, Direction=X_3)
Z_4 = UnitZ(Factor=1)
extr_12 = Extrude(Base=extr_11, Direction=Z_4)
smesh_3 = SimpleMesh(Brep=extr_9)  # -> flatten(Mesh)
smesh_4 = SimpleMesh(Brep=extr_12)  # -> flatten(Mesh)
smesh_5 = SimpleMesh(Brep=extr_10)  # -> flatten(Mesh)
pt_3 = ConstructPoint(XCoordinate=0, YCoordinate=0, ZCoordinate=0)
merge = Merge(Data1=smesh_4, Data2=smesh_5, Data3=smesh_3)
tri = Triangulate(Mesh=[merge, mesh, smesh_2, smesh])  # -> flatten(Mesh), Count
scale = Scale(Geometry=flatten(tri.Mesh), Center=pt_3, Factor="0.0254")  # -> Geometry, Transform

# ---- group: RH_OUT:Window
mesh_2 = Mesh(scale.Geometry)
