# Grasshopper definition hackhaton5.gh (Grasshopper 1.0.5)

pt = Point(Point(2919.914683, 1973.444328, -6.5))
pt_2 = Point(Point(3263.578487, -42.87340651, -6.5))
pt_3 = Point(Point(2919.914683, 1973.444328, -6.5))
pt_4 = Point(Point(3263.578487, -42.87340651, -6.5))
pt_5 = Point(Point(2919.914683, 1973.444328, -6.5))
pt_6 = Point(Point(3263.578487, -42.87340651, -6.5))
pt_7 = Point(Point(2919.914683, 1973.444328, -6.5))
pt_8 = Point(Point(3263.578487, -42.87340651, -6.5))
num = Number(Slider(150.5, range=0..1000))
num_2 = Number(Slider(150.5, range=0..1000))
num_3 = Number(Slider(150.5, range=0..1000))
num_4 = Number(Slider(150.5, range=0..1000))
ln = Line(StartPoint=pt, EndPoint=pt_2)
ln_2 = Line(StartPoint=pt_3, EndPoint=pt_4)
ln_3 = Line(StartPoint=pt_5, EndPoint=pt_6)
ln_4 = Line(StartPoint=pt_7, EndPoint=pt_8)
Z = UnitZ(Factor=num)
Z_2 = UnitZ(Factor=num_2)
Z_3 = UnitZ(Factor=num_3)
number_slider = Slider(17, range=0..100)
Z_4 = UnitZ(Factor=num_4)
number_slider_2 = Slider(17, range=0..100)
number_slider_3 = Slider(17, range=0..100)
number_slider_4 = Slider(17, range=0..100)
extr = Extrude(Base=ln, Direction=Z)
extr_2 = Extrude(Base=ln_2, Direction=Z_2)
extr_3 = Extrude(Base=ln_3, Direction=Z_3)
extr_4 = Extrude(Base=ln_4, Direction=Z_4)
divide = DivideDomain²(Domain=extr, UCount=Slider(3, range=0..10), VCount=number_slider)
divide_2 = DivideDomain²(Domain=extr_2, UCount=Slider(3, range=0..10), VCount=number_slider_2)
divide_3 = DivideDomain²(Domain=extr_3, UCount=Slider(3, range=0..10), VCount=number_slider_3)
divide_4 = DivideDomain²(Domain=extr_4, UCount=Slider(3, range=0..10), VCount=number_slider_4)
subsrf = Isotrim(Surface=extr, Domain=divide)
subsrf_2 = Isotrim(Surface=extr_2, Domain=divide_2)
subsrf_3 = Isotrim(Surface=extr_3, Domain=divide_3)
subsrf_4 = Isotrim(Surface=extr_4, Domain=divide_4)
partition = PartitionList(List=subsrf, Size=number_slider)
partition_2 = PartitionList(List=subsrf_2, Size=number_slider_2)
partition_3 = PartitionList(List=subsrf_3, Size=number_slider_3)
partition_4 = PartitionList(List=subsrf_4, Size=number_slider_4)
flip = FlipMatrix(Data=partition)
flip_2 = FlipMatrix(Data=partition_2)
flip_3 = FlipMatrix(Data=partition_3)
flip_4 = FlipMatrix(Data=partition_4)
item = ListItem(List=flip, Index=0, Wrap=True)  # -> Item, flatten(Item1)
item_2 = ListItem(List=flip_2, Index=0, Wrap=True)  # -> Item, flatten(Item1)
item_3 = ListItem(List=flip_3, Index=0, Wrap=True)  # -> Item, flatten(Item1)
item_4 = ListItem(List=flip_4, Index=0, Wrap=True)  # -> Item, flatten(Item1)
data = Data(item.Item1)
data_2 = Data(item_2.Item1)
data_3 = Data(item_3.Item1)
data_4 = Data(item_4.Item1)
dispatch = Dispatch(List=data, DispatchPattern=[True, False])  # -> ListA, ListB
dispatch_2 = Dispatch(List=data_2, DispatchPattern=[True, False])  # -> ListA, ListB
dispatch_3 = Dispatch(List=data_3, DispatchPattern=[True, False])  # -> ListA, ListB
dispatch_4 = Dispatch(List=data_4, DispatchPattern=[True, False])  # -> ListA, ListB
data_5 = Data(data)
data_6 = Data(data_2)
data_7 = Data(data_3)
data_8 = Data(data_4)
area = Area(Geometry=data_5)  # -> Area, Centroid
area_2 = Area(Geometry=data_6)  # -> Area, Centroid
area_3 = Area(Geometry=data_7)  # -> Area, Centroid
area_4 = Area(Geometry=data_8)  # -> Area, Centroid
srf_cp = SurfaceClosestPoint(Point=area.Centroid, Surface=item.Item1)  # -> Point, UVPoint, Distance
srf_cp_2 = SurfaceClosestPoint(Point=area_2.Centroid, Surface=item_2.Item1)  # -> Point, UVPoint, Distance
srf_cp_3 = SurfaceClosestPoint(Point=area_3.Centroid, Surface=item_3.Item1)  # -> Point, UVPoint, Distance
srf_cp_4 = SurfaceClosestPoint(Point=area_4.Centroid, Surface=item_4.Item1)  # -> Point, UVPoint, Distance

# ---- group: RH_IN:Height
num_5 = Number(Slider(0.8, range=0.5..0.9))

# ---- group: RH_IN:Width
num_6 = Number(Slider(0.8, range=0.3..0.8))

# ---- group: RH_IN:Height
num_7 = Number(Slider(0.9, range=0.5..0.9))

# ---- group: RH_IN:Width
num_8 = Number(Slider(0.8, range=0.3..0.8))

# ---- group: RH_IN:Height
num_9 = Number(Slider(0.8, range=0.5..0.9))

num_10 = Number(Slider(0.8, range=0.5..0.9))

# ---- group: RH_IN:Width
num_11 = Number(Slider(0.8, range=0.3..0.8))

num_12 = Number(Slider(0.7, range=0.3..0.8))

# ----
evalsrf = EvaluateSurface(Surface=item.Item1, Point=srf_cp.UVPoint)  # -> Point, Normal, UDirection, VDirection, Frame
evalsrf_2 = EvaluateSurface(Surface=item_2.Item1, Point=srf_cp_2.UVPoint)  # -> Point, Normal, UDirection, VDirection, Frame
evalsrf_3 = EvaluateSurface(Surface=item_3.Item1, Point=srf_cp_3.UVPoint)  # -> Point, Normal, UDirection, VDirection, Frame
evalsrf_4 = EvaluateSurface(Surface=item_4.Item1, Point=srf_cp_4.UVPoint)  # -> Point, Normal, UDirection, VDirection, Frame
scale_nu = ScaleNU(Geometry=data_5, Plane=evalsrf.Frame, ScaleX=num_5, ScaleY=num_6, ScaleZ=1)  # -> Geometry, Transform
scale_nu_2 = ScaleNU(Geometry=data_6, Plane=evalsrf_2.Frame, ScaleX=num_7, ScaleY=num_8, ScaleZ=1)  # -> Geometry, Transform
scale_nu_3 = ScaleNU(Geometry=data_7, Plane=evalsrf_3.Frame, ScaleX=num_9, ScaleY=num_11, ScaleZ=1)  # -> Geometry, Transform
scale_nu_4 = ScaleNU(Geometry=data_8, Plane=evalsrf_4.Frame, ScaleX=num_10, ScaleY=num_12, ScaleZ=1)  # -> Geometry, Transform
division = Division(A=num_4, B=Slider(3, range=0..10))
Z_5 = UnitZ(Factor=division)
multiplication = Multiplication(A=division, B="2")
extr_5 = Extrude(Base=ln_4, Direction=Z_5)
move = Move(Geometry=extr_5, Motion=Z_5)  # -> Geometry, Transform
Z_6 = UnitZ(Factor=multiplication)
debrep = DeconstructBrep(Brep=scale_nu.Geometry)  # -> Faces, Edges, Vertices
debrep_2 = DeconstructBrep(Brep=scale_nu_2.Geometry)  # -> Faces, Edges, Vertices
debrep_3 = DeconstructBrep(Brep=scale_nu_3.Geometry)  # -> Faces, Edges, Vertices
debrep_4 = DeconstructBrep(Brep=scale_nu_4.Geometry)  # -> Faces, Edges, Vertices
debrep_5 = DeconstructBrep(Brep=move.Geometry)  # -> Faces, Edges, Vertices
move_2 = Move(Geometry=extr_5, Motion=Z_6)  # -> Geometry, Transform
join = JoinCurves(Curves=debrep_4.Edges, Preserve=False)  # -> flatten(Curves)
join_2 = JoinCurves(Curves=debrep_5.Edges, Preserve=False)  # -> flatten(Curves)
join_3 = JoinCurves(Curves=[join_2, join], Preserve=False)
item_5 = ListItem(List=evalsrf.Frame, Index=0, Wrap=True)
item_6 = ListItem(List=evalsrf_2.Frame, Index=0, Wrap=True)
item_7 = ListItem(List=evalsrf_3.Frame, Index=0, Wrap=True)
item_8 = ListItem(List=evalsrf_4.Frame, Index=0, Wrap=True)
deplane = DeconstructPlane(Plane=item_5)  # -> Origin, XAxis, YAxis, ZAxis
deplane_2 = DeconstructPlane(Plane=item_6)  # -> Origin, XAxis, YAxis, ZAxis
deplane_3 = DeconstructPlane(Plane=item_7)  # -> Origin, XAxis, YAxis, ZAxis
deplane_4 = DeconstructPlane(Plane=item_8)  # -> Origin, XAxis, YAxis, ZAxis
boundary = BoundarySurfaces(Edges=join_3)
multiplication_2 = Multiplication(A=deplane_4.ZAxis, B=Slider(2, range=0..10))
multiplication_3 = Multiplication(A=deplane.ZAxis, B=Slider(12, range=0..100))
multiplication_4 = Multiplication(A=deplane_2.ZAxis, B=Slider(12, range=0..100))
multiplication_5 = Multiplication(A=deplane_3.ZAxis, B=Slider(12, range=0..100))
multiplication_6 = Multiplication(A=deplane_4.ZAxis, B=Slider(12, range=0..100))
extr_6 = Extrude(Base=extr_5, Direction=multiplication_6)
extr_7 = Extrude(Base=move_2.Geometry, Direction=multiplication_6)
extr_8 = Extrude(Base=scale_nu_4.Geometry, Direction=multiplication_2)
extr_9 = Extrude(Base=boundary, Direction=multiplication_6)
evalsrf_5 = EvaluateSurface(Surface=reparameterize(extr), Point="0.5,0.5")  # -> Point, Normal, UDirection, VDirection, Frame
evalsrf_6 = EvaluateSurface(Surface=reparameterize(extr_2), Point="0.5,0.5")  # -> Point, Normal, UDirection, VDirection, Frame
evalsrf_7 = EvaluateSurface(Surface=reparameterize(extr_3), Point="0.5,0.5")  # -> Point, Normal, UDirection, VDirection, Frame
smesh = SimpleMesh(Brep=extr_6)
smesh_2 = SimpleMesh(Brep=extr_7)
mesh = Mesh(extr_9)
move_3 = Move(Geometry=debrep.Edges, Motion=multiplication_3)  # -> Geometry, Transform
amp = Amplitude(Vector=evalsrf_5.Normal, Amplitude=Slider(43, range=0..100))
move_4 = Move(Geometry=debrep_2.Edges, Motion=multiplication_4)  # -> Geometry, Transform
amp_2 = Amplitude(Vector=evalsrf_6.Normal, Amplitude=Slider(22, range=0..100))
amp_3 = Amplitude(Vector=evalsrf_7.Normal, Amplitude=Slider(30, range=0..100))
move_5 = Move(Geometry=debrep_3.Edges, Motion=multiplication_5)  # -> Geometry, Transform
smesh_3 = SimpleMesh(Brep=extr_8)
item_9 = ListItem(List=move_3.Geometry, Index=0, Wrap=True)
item_10 = ListItem(List=move_5.Geometry, Index=1, Wrap=True)
item_11 = ListItem(List=move_4.Geometry, Index=2, Wrap=True)
extr_10 = Extrude(Base=item_9, Direction=amp)
extr_11 = Extrude(Base=item_10, Direction=amp_3)
extr_12 = Extrude(Base=item_11, Direction=amp_2)
evalsrf_8 = EvaluateSurface(Surface=reparameterize(extr_10), Point="0.5,0.5")  # -> Point, Normal, UDirection, VDirection, Frame
evalsrf_9 = EvaluateSurface(Surface=reparameterize(debrep_4.Faces), Point="0.5,0.5")  # -> Point, Normal, UDirection, VDirection, Frame
panel = Panel("0.5,0.5")
evalsrf_10 = EvaluateSurface(Surface=reparameterize(extr_11), Point="0.5,0.5")  # -> Point, Normal, UDirection, VDirection, Frame
amp_4 = Amplitude(Vector=evalsrf_8.Normal, Amplitude=Slider(3, range=0..10))
amp_5 = Amplitude(Vector=evalsrf_9.Normal, Amplitude=Slider(5, range=0..10))
evalsrf_11 = EvaluateSurface(Surface=reparameterize(extr_12), Point="0.5,0.5")  # -> Point, Normal, UDirection, VDirection, Frame
amp_6 = Amplitude(Vector=evalsrf_10.Normal, Amplitude=Slider(3, range=0..10))
extr_13 = Extrude(Base=extr_10, Direction=amp_4)
mjoin = MeshJoin(Meshes=flatten([mesh, smesh_2, smesh]))
amp_7 = Amplitude(Vector=evalsrf_11.Normal, Amplitude=Slider(3, range=0..10))
pt_9 = ConstructPoint(XCoordinate=0, YCoordinate=0, ZCoordinate=0)
extr_14 = Extrude(Base=extr_11, Direction=amp_6)
move_6 = Move(Geometry=smesh_3, Motion=amp_5)  # -> Geometry, Transform
pt_10 = ConstructPoint(XCoordinate=0, YCoordinate=0, ZCoordinate=0)
pt_11 = ConstructPoint(XCoordinate=0, YCoordinate=0, ZCoordinate=0)
pt_12 = ConstructPoint(XCoordinate=0, YCoordinate=0, ZCoordinate=0)
extr_15 = Extrude(Base=extr_12, Direction=amp_7)
scale = Scale(Geometry=extr_13, Center=pt_10, Factor="0.0254")  # -> Geometry, Transform
scale_2 = Scale(Geometry=mjoin, Center=pt_11, Factor="0.0254")  # -> Geometry, Transform
scale_3 = Scale(Geometry=move_6.Geometry, Center=pt_9, Factor="0.0254")  # -> Geometry, Transform
scale_4 = Scale(Geometry=extr_14, Center=pt_12, Factor="0.0254")  # -> Geometry, Transform

# ---- group: RH_OUT:Shader2
mesh_2 = Mesh(scale.Geometry)

# ---- group: RH_OUT:Window
mesh_3 = Mesh(scale_2.Geometry)

# ---- group: RH_OUT:Glass
mesh_4 = Mesh(scale_3.Geometry)

# ---- group: RH_OUT:Shader1
mesh_5 = Mesh(scale_4.Geometry)

# ----
pt_13 = ConstructPoint(XCoordinate=0, YCoordinate=0, ZCoordinate=0)
scale_5 = Scale(Geometry=extr_15, Center=pt_13, Factor="0.0254")  # -> Geometry, Transform

# ---- group: RH_OUT:Shader3
mesh_6 = Mesh(scale_5.Geometry)
