# Grasshopper definition hackhaton8.gh (Grasshopper 1.0.5)

pt = Point(Point(2919.914683, 1973.444328, -6.5))
pt_2 = Point(Point(3263.578487, -42.87340651, -6.5))
num = Number(Slider(150.5, range=0..1000))
ln = Line(StartPoint=pt, EndPoint=pt_2)
Z = UnitZ(Factor=num)
number_slider = Slider(17, range=0..100)
extr = Extrude(Base=ln, Direction=Z)
divide = DivideDomain²(Domain=extr, UCount=Slider(3, range=0..10), VCount=number_slider)
subsrf = Isotrim(Surface=extr, Domain=divide)
partition = PartitionList(List=subsrf, Size=number_slider)
flip = FlipMatrix(Data=partition)
item = ListItem(List=flip, Index=0, Wrap=True)  # -> Item, flatten(Item1)
data = Data(item.Item1)
dispatch = Dispatch(List=data, DispatchPattern=[True, False])  # -> ListA, ListB
data_2 = Data(data)
area = Area(Geometry=data_2)  # -> Area, Centroid
srf_cp = SurfaceClosestPoint(Point=area.Centroid, Surface=item.Item1)  # -> Point, UVPoint, Distance

# ---- group: RH_IN:Height
num_2 = Number(Slider(0.8, range=0.5..0.9))

# ---- group: RH_IN:Width
num_3 = Number(Slider(0.7, range=0.3..0.8))

# ----
evalsrf = EvaluateSurface(Surface=item.Item1, Point=srf_cp.UVPoint)  # -> Point, Normal, UDirection, VDirection, Frame
scale_nu = ScaleNU(Geometry=data_2, Plane=evalsrf.Frame, ScaleX=num_2, ScaleY=num_3, ScaleZ=1)  # -> Geometry, Transform
division = Division(A=num, B=Slider(3, range=0..10))
Z_2 = UnitZ(Factor=division)
debrep = DeconstructBrep(Brep=scale_nu.Geometry)  # -> Faces, Edges, Vertices; disabled
multiplication = Multiplication(A=division, B="2")
extr_2 = Extrude(Base=ln, Direction=Z_2)
move = Move(Geometry=extr_2, Motion=Z_2)  # -> Geometry, Transform
debrep_2 = DeconstructBrep(Brep=scale_nu.Geometry)  # -> Faces, Edges, Vertices; disabled
Z_3 = UnitZ(Factor=multiplication)
debrep_3 = DeconstructBrep(Brep=scale_nu.Geometry)  # -> Faces, Edges, Vertices
debrep_4 = DeconstructBrep(Brep=move.Geometry)  # -> Faces, Edges, Vertices
move_2 = Move(Geometry=extr_2, Motion=Z_3)  # -> Geometry, Transform
number_slider_2 = Slider(12, range=0..100)  # disabled
join = JoinCurves(Curves=debrep_3.Edges, Preserve=False)  # -> flatten(Curves)
join_2 = JoinCurves(Curves=debrep_4.Edges, Preserve=False)  # -> flatten(Curves)
number_slider_3 = Slider(12, range=0..100)  # disabled
item_2 = ListItem(List=evalsrf.Frame, Index=0, Wrap=True)  # disabled
item_3 = ListItem(List=evalsrf.Frame, Index=0, Wrap=True)  # disabled
join_3 = JoinCurves(Curves=[join_2, join], Preserve=False)
deplane = DeconstructPlane(Plane=item_2)  # -> Origin, XAxis, YAxis, ZAxis; disabled
item_4 = ListItem(List=evalsrf.Frame, Index=0, Wrap=True)
deplane_2 = DeconstructPlane(Plane=item_3)  # -> Origin, XAxis, YAxis, ZAxis; disabled
deplane_3 = DeconstructPlane(Plane=item_4)  # -> Origin, XAxis, YAxis, ZAxis
multiplication_2 = Multiplication(A=deplane.ZAxis, B=number_slider_2)  # disabled
number_slider_4 = Slider(31, range=0..100)  # disabled
number_slider_5 = Slider(3, range=0..10)  # disabled
boundary = BoundarySurfaces(Edges=join_3)
number_slider_6 = Slider(32, range=0..100)  # disabled
multiplication_3 = Multiplication(A=deplane_2.ZAxis, B=number_slider_3)  # disabled
number_slider_7 = Slider(3, range=0..10)  # disabled
panel = Panel("0.5,0.5")  # disabled
multiplication_4 = Multiplication(A=deplane_3.ZAxis, B=Slider(12, range=0..100))
panel_2 = Panel("0.5,0.5")  # disabled
int = Integer(number_slider_4)  # disabled
evalsrf_2 = EvaluateSurface(Surface=reparameterize(extr), Point=panel)  # -> Point, Normal, UDirection, VDirection, Frame; disabled
int_2 = Integer(number_slider_6)  # disabled
extr_3 = Extrude(Base=extr_2, Direction=multiplication_4)
extr_4 = Extrude(Base=move_2.Geometry, Direction=multiplication_4)
evalsrf_3 = EvaluateSurface(Surface=reparameterize(extr), Point=panel_2)  # -> Point, Normal, UDirection, VDirection, Frame; disabled
extr_5 = Extrude(Base=boundary, Direction=multiplication_4)
smesh = SimpleMesh(Brep=extr_3)
smesh_2 = SimpleMesh(Brep=extr_4)
move_3 = Move(Geometry=debrep.Edges, Motion=multiplication_2)  # -> Geometry, Transform; disabled
amp = Amplitude(Vector=evalsrf_2.Normal, Amplitude=int)  # disabled
mesh = Mesh(extr_5)
amp_2 = Amplitude(Vector=evalsrf_3.Normal, Amplitude=int_2)  # disabled
move_4 = Move(Geometry=debrep_2.Edges, Motion=multiplication_3)  # -> Geometry, Transform; disabled
item_5 = ListItem(List=move_3.Geometry, Index=0, Wrap=True)  # -> Item, Item1, Item2; disabled
item_6 = ListItem(List=move_4.Geometry, Index=1, Wrap=True)  # disabled
extr_6 = Extrude(Base=item_5.Item, Direction=amp)  # disabled
extr_7 = Extrude(Base=item_6, Direction=amp_2)  # disabled
panel_3 = Panel("0.5,0.5")  # disabled
evalsrf_4 = EvaluateSurface(Surface=reparameterize(extr_6), Point=panel_3)  # -> Point, Normal, UDirection, VDirection, Frame; disabled
panel_4 = Panel("0.5,0.5")  # disabled
extr_8 = Extrude(Base=item_5.Item2, Direction=amp)  # disabled
evalsrf_5 = EvaluateSurface(Surface=reparameterize(extr_7), Point=panel_4)  # -> Point, Normal, UDirection, VDirection, Frame; disabled
amp_3 = Amplitude(Vector=evalsrf_4.Normal, Amplitude=number_slider_5)  # disabled
panel_5 = Panel("0.5,0.5")  # disabled
panel_6 = Panel("0.5,0.5")  # disabled
extr_9 = Extrude(Base=extr_6, Direction=amp_3)  # disabled
amp_4 = Amplitude(Vector=evalsrf_5.Normal, Amplitude=number_slider_7)  # disabled
evalsrf_6 = EvaluateSurface(Surface=reparameterize(extr_8), Point=panel_6)  # -> Point, Normal, UDirection, VDirection, Frame; disabled
pt_3 = ConstructPoint(XCoordinate=0, YCoordinate=0, ZCoordinate=0)  # disabled
extr_10 = Extrude(Base=extr_7, Direction=amp_4)  # disabled
mjoin = MeshJoin(Meshes=flatten([mesh, smesh_2, smesh]))
panel_7 = Panel("0.0254")  # disabled
pt_4 = ConstructPoint(XCoordinate=0, YCoordinate=0, ZCoordinate=0)  # disabled
amp_5 = Amplitude(Vector=evalsrf_6.Normal, Amplitude=number_slider_5)  # disabled
pt_5 = ConstructPoint(XCoordinate=0, YCoordinate=0, ZCoordinate=0)
scale = Scale(Geometry=extr_9, Center=pt_3, Factor=panel_7)  # -> Geometry, Transform; disabled
panel_8 = Panel("0.0254")  # disabled
scale_2 = Scale(Geometry=extr_10, Center=pt_4, Factor=panel_8)  # -> Geometry, Transform; disabled
mesh_2 = Mesh(scale.Geometry)  # disabled
scale_3 = Scale(Geometry=mjoin, Center=pt_5, Factor="0.0254")  # -> Geometry, Transform
extr_11 = Extrude(Base=extr_8, Direction=amp_5)  # disabled
mesh_3 = Mesh(scale_2.Geometry)  # disabled
mesh_4 = Mesh(scale_3.Geometry)
pt_6 = ConstructPoint(XCoordinate=0, YCoordinate=0, ZCoordinate=0)  # disabled
panel_9 = Panel("0.0254")  # disabled
scale_4 = Scale(Geometry=extr_11, Center=pt_6, Factor=panel_9)  # -> Geometry, Transform; disabled
mesh_5 = Mesh(scale_4.Geometry)  # disabled
merge = Merge(Data1=flatten(mesh_2), Data2=flatten(mesh_5), Data3=flatten(mesh_4), Data4=flatten(mesh_3))  # -> flatten(Result); disabled

# ---- group: RH_OUT:Win
mesh_6 = Mesh(scale_3.Geometry)

# ----
mjoin_2 = MeshJoin(Meshes=merge)  # disabled
