# Grasshopper definition hackhaton9.gh (Grasshopper 1.0.5)

pt = Point(Point(2919.914683, 1973.444328, -6.5))
pt_2 = Point(Point(3263.578487, -42.87340651, -6.5))
num = Number(Slider(150.5, range=0..1000))
ln = Line(StartPoint=pt, EndPoint=pt_2)
Z = UnitZ(Factor=num)
number_slider = Slider(17, range=0..100)
extr = Extrude(Base=ln, Direction=Z)
divide = DivideDomain²(Domain=extr, UCount=Slider(3, range=0..10), VCount=number_slider)
subsrf = Isotrim(Surface=extr, Domain=divide)
partition = PartitionList(List=subsrf, Size=number_slider)
flip = FlipMatrix(Data=partition)
item = ListItem(List=flip, Index=0, Wrap=True)  # -> Item, flatten(Item1)
data = Data(item.Item1)
dispatch = Dispatch(List=data, DispatchPattern=[True, False])  # -> ListA, ListB
data_2 = Data(data)
area = Area(Geometry=data_2)  # -> Area, Centroid
srf_cp = SurfaceClosestPoint(Point=area.Centroid, Surface=item.Item1)  # -> Point, UVPoint, Distance

# ---- group: RH_IN:Height
num_2 = Number(Slider(0.8, range=0.5..0.9))

# ---- group: RH_IN:Width
num_3 = Number(Slider(0.8, range=0.3..0.8))

# ----
evalsrf = EvaluateSurface(Surface=item.Item1, Point=srf_cp.UVPoint)  # -> Point, Normal, UDirection, VDirection, Frame
scale_nu = ScaleNU(Geometry=data_2, Plane=evalsrf.Frame, ScaleX=num_2, ScaleY=num_3, ScaleZ=1)  # -> Geometry, Transform
division = Division(A=num, B=Slider(3, range=0..10))
Z_2 = UnitZ(Factor=division)
multiplication = Multiplication(A=division, B="2")
extr_2 = Extrude(Base=ln, Direction=Z_2)
move = Move(Geometry=extr_2, Motion=Z_2)  # -> Geometry, Transform
Z_3 = UnitZ(Factor=multiplication)
debrep = DeconstructBrep(Brep=scale_nu.Geometry)  # -> Faces, Edges, Vertices
debrep_2 = DeconstructBrep(Brep=move.Geometry)  # -> Faces, Edges, Vertices
move_2 = Move(Geometry=extr_2, Motion=Z_3)  # -> Geometry, Transform
join = JoinCurves(Curves=debrep.Edges, Preserve=False)  # -> flatten(Curves)
item_2 = ListItem(List=debrep.Edges, Index=0, Wrap=True)  # -> Item, Item1, Item2
join_2 = JoinCurves(Curves=debrep_2.Edges, Preserve=False)  # -> flatten(Curves)
join_3 = JoinCurves(Curves=[join_2, join], Preserve=False)
item_3 = ListItem(List=evalsrf.Frame, Index=0, Wrap=True)
deplane = DeconstructPlane(Plane=item_3)  # -> Origin, XAxis, YAxis, ZAxis
boundary = BoundarySurfaces(Edges=join_3)
X = UnitX(Factor="12")

# ---- group: RH_IN:Horiz
int = Integer(Slider(9, range=0..36))

# ----
multiplication_2 = Multiplication(A=deplane.ZAxis, B=Slider(12, range=0..100))
X_2 = UnitX(Factor=int)
X_3 = UnitX(Factor=Slider(8, range=0..36))
multiplication_3 = Multiplication(A=deplane.ZAxis, B=Slider(2, range=0..10))
neg = Negative(Value=X_2)
neg_2 = Negative(Value=X_3)
extr_3 = Extrude(Base=boundary, Direction=multiplication_2)
extr_4 = Extrude(Base=extr_2, Direction=multiplication_2)
extr_5 = Extrude(Base=move_2.Geometry, Direction=multiplication_2)
extr_6 = Extrude(Base=scale_nu.Geometry, Direction=multiplication_3)
extr_7 = Extrude(Base=[item_2.Item, item_2.Item2], Direction=X_2)
extr_8 = Extrude(Base=item_2.Item1, Direction=X_3)
smesh = SimpleMesh(Brep=extr_4)
smesh_2 = SimpleMesh(Brep=extr_5)
move_3 = Move(Geometry=extr_7, Motion=X)  # -> Geometry, Transform
move_4 = Move(Geometry=extr_8, Motion=X)  # -> Geometry, Transform
mesh = Mesh(extr_3)
Y = UnitY(Factor=1)
Z_4 = UnitZ(Factor=1)
extr_9 = Extrude(Base=move_3.Geometry, Direction=Y)
extr_10 = Extrude(Base=move_4.Geometry, Direction=Z_4)
mjoin = MeshJoin(Meshes=flatten([mesh, smesh_2, smesh]))
smesh_3 = SimpleMesh(Brep=extr_9)  # -> flatten(Mesh)
smesh_4 = SimpleMesh(Brep=extr_10)  # -> flatten(Mesh)
pt_3 = ConstructPoint(XCoordinate=0, YCoordinate=0, ZCoordinate=0)
scale = Scale(Geometry=[mjoin, smesh_3, smesh_4], Center=pt_3, Factor="0.0254")  # -> Geometry, Transform

# ---- group: RH_OUT:Window
mesh_2 = Mesh(scale.Geometry)
