# Grasshopper definition woodslats.gh (Grasshopper 1.0.6)

# ---- group: RH_IN:Spacing
num = Number(Slider(0.61, range=0..1))

# ----
multiplication = Multiplication(A=num, B=Slider(0.06, range=0.01..0.08))
data = Data([1.04637353, 6.044384945, 6.044384945, 1.04637353])
data_2 = Data([8.293100069, 8.293100069, 8.293100069, 8.293100069])
data_3 = Data([-3.96916073, -3.96916073, 4.20821933, 4.20821933])
addition = Addition(A=multiplication, B=Slider(0.04, range=0..0.1))

# ---- group: RH_IN:Depth
num_2 = Number(Slider(0.48, range=0..1))

# ----
neg = Negative(Value=data)
pt = ConstructPoint(XCoordinate=data_3, YCoordinate=neg, ZCoordinate=data_2)
item = ListItem(List=pt, Index=0, Wrap=True)  # -> Item, Item1, Item2, Item3
multiplication_2 = Multiplication(A=num_2, B=Slider(0.08, range=0..1))

# ---- group: RH_IN:Rotation
int = Integer(Slider(45, range=0..45))

# ----
srf4pt = _4PointSurface(CornerA=item.Item, CornerB=item.Item1, CornerC=item.Item2, CornerD=item.Item3)
addition_2 = Addition(A=multiplication_2, B=Slider(0.04, range=0..0.1))
vec = VectorXYZ(XComponent="100", YComponent=int, ZComponent=0)  # -> Vector, Length
unit = UnitVector(Vector=vec.Vector)
contour = Contour(Shape=srf4pt, Point=Point(0, 0, 0), Direction=unit, Distance=addition)  # -> flatten(Contours)
neg_2 = Negative(Value=addition_2)
partition = PartitionList(List=contour, Size="2")
Z = UnitZ(Factor=neg_2)
loft = Loft(Curves=partition, Options={Adjust=False, Closed=False, LoftEnds=0, LoftSimp=0, LoftType=0, Rebuild=10, Refit=0.01})  # -> flatten(Loft)
extr = Extrude(Base=loft, Direction=Z)
panel = Panel("""0
1""")
cull = CullPattern(List=extr, CullPattern=panel)

# ---- group: RH_OUT:Geo
mesh = Mesh(cull)
